# Grasshopper definition main.ghx (Grasshopper 1.0.7)
# plug-ins: Human

number_slider = Slider(10, range=0..10)
rectangle = Rectangle(Plane=PlaneXY(0, 0, 0), XSize=number_slider, YSize=number_slider, Radius=0)  # -> Rectangle, Length
rectangular_array = RectangularArray(Geometry=rectangle.Rectangle, Cell=rectangle.Rectangle, XCount=Slider(10, range=0..10), YCount=Slider(10, range=0..10))  # -> Geometry, Transform

geometry = Geometry(rectangular_array.Geometry)
random = Random(Range=Domain(0, 1), Number=Slider(10, range=0..10), Seed=2)
list_length = ListLength(List=rectangular_array.Geometry)  # -> expr("x-1", Length)
remap_numbers = RemapNumbers(Value=random, Source=Domain(0, 1), Target=list_length)  # -> Mapped, Clipped
integer = Integer(remap_numbers.Mapped)
cull_index = CullIndex(List=geometry, Indices=integer, Wrap=True)

average = Average(Input=random)
list_length_2 = ListLength(List=cull_index)  # -> expr("x-1", Length)
remap_numbers_2 = RemapNumbers(Value=average, Source=Domain(0, 1), Target=list_length_2)  # -> Mapped, Clipped
integer_2 = Integer(remap_numbers_2.Mapped)

custom_preview_lineweights = CustomPreviewLineweights(Geometry=rectangular_array.Geometry, Shader=ColourSwatch(SwatchColor=RGB(8, 0, 255)), Absolute=False)
list_item = ListItem(List=geometry, Index=integer_2, Wrap=True)
list_item_2 = ListItem(List=rectangular_array.Geometry, Index=integer, Wrap=False)
surface = Surface(list_item)
surface_2 = Surface(list_item_2)
custom_preview = CustomPreview(Geometry=surface, Material=ColourSwatch(SwatchColor=RGB(255, 0, 0)))
custom_preview_2 = CustomPreview(Geometry=surface_2, Material=ColourSwatch(SwatchColor=RGB(8, 0, 255)))
